# Dynamo graph Base_Random.dyn (Dynamo 2.18.1.5096)

# group: Pièces
# note: Pièces

# group: Pièces
# note: Pièces

# group: Input
# note: Cible de sortie
select_model_element = DSModelElementSelection()  # 1 picked in the model

curves = Element.Curves(element=select_model_element)

# group: Input
# note: Obstacle
select_model_elements = DSModelElementsSelection()  # 4 picked in the model

curves_2 = Element.Curves(element=select_model_elements)

# group: Input
# note: Cadre de jeu
select_model_elements_2 = DSModelElementsSelection()  # 5 picked in the model

curves_3 = Element.Curves(element=select_model_elements_2)

# group: Input
# note: Amorce
select_model_element_2 = DSModelElementSelection()  # 1 picked in the model

curves_4 = Element.Curves(element=select_model_element_2)

# group: Input
# note: Angle Droite 15°
select_model_elements_3 = DSModelElementsSelection()  # 2 picked in the model

curves_5 = Element.Curves(element=select_model_elements_3)
flatten = List.Flatten(list=curves_5)
byJoinedCurves = PolyCurve.ByJoinedCurves(curves=flatten)

# group: Input
# note: Angle Droite 45°
select_model_elements_4 = DSModelElementsSelection()  # 2 picked in the model

curves_6 = Element.Curves(element=select_model_elements_4)
flatten_2 = List.Flatten(list=curves_6)
byJoinedCurves_2 = PolyCurve.ByJoinedCurves(curves=flatten_2)

# group: Input
# note: Segment droit
select_model_element_3 = DSModelElementSelection()  # 1 picked in the model

curves_7 = Element.Curves(element=select_model_element_3)

# group: Input
# note: Angle Gauche 45°
select_model_elements_5 = DSModelElementsSelection()  # 2 picked in the model

curves_8 = Element.Curves(element=select_model_elements_5)
flatten_3 = List.Flatten(list=curves_8)
byJoinedCurves_3 = PolyCurve.ByJoinedCurves(curves=flatten_3)

# group: Input
# note: Angle Gauche 15°
select_model_elements_6 = DSModelElementsSelection()  # 2 picked in the model

curves_9 = Element.Curves(element=select_model_elements_6)
flatten_4 = List.Flatten(list=curves_9)
byJoinedCurves_4 = PolyCurve.ByJoinedCurves(curves=flatten_4)
list_create = List.Create(item0=curves_4, item1=byJoinedCurves, item2=byJoinedCurves_2, item3=curves_7, item4=byJoinedCurves_3, item5=byJoinedCurves_4)
# note: Liste de toutes les pièces
flatten_5 = List.Flatten(list=list_create)
# note: Liste des pièces de jeu
restOfItems = List.RestOfItems(list=flatten_5)
code_block = CodeBlock { 0; 1; }
number_slider = DoubleSlider(6, range=5..15 step 1)
randomList = Math.RandomList(amount=number_slider)
code_block_2 = CodeBlock { 0; 4; }
# note: Random global des pièces
mapTo = Math.MapTo(rangeMin=code_block.out0, rangeMax=code_block.out1, inputValue=randomList, targetRangeMin=code_block_2.out0, targetRangeMax=code_block_2.out1)
code_block_3 = CodeBlock { 0; }
round = Math.Round(number=mapTo, digits=code_block_3)
getItemAtIndex = List.GetItemAtIndex(list=restOfItems, index=round)
code_block_4 = CodeBlock { 1; }
tangentAtParameter = Curve.TangentAtParameter(curve=restOfItems, param=code_block_4)
getItemAtIndex_2 = List.GetItemAtIndex(list=tangentAtParameter, index=round)

# group: Background
# note: Crée listes cumulées
python_script = Python(IN[0]=round)  # CPython3
# ---------- python_script.python (13 lines) ----------
# Load the Python Standard and DesignScript Libraries
import sys
import clr
clr.AddReference('ProtoGeometry')
from Autodesk.DesignScript.Geometry import *

# The inputs to this node will be stored as a list in the IN variables.
l = IN[0]

# Place your code below this line
ls = [l[:i+1] for i in range(len(l))]
# Assign your output to the OUT variable.
OUT = ls
# ----------------------------------------

getItemAtIndex_3 = List.GetItemAtIndex(list=restOfItems, index=round)
startPoint = Curve.StartPoint(curve=restOfItems)
byOrigin = CoordinateSystem.ByOrigin(origin=startPoint)
getItemAtIndex_4 = List.GetItemAtIndex(list=byOrigin, index=round)
# note: Element d'amorce
firstItem = List.FirstItem(list=flatten_5)
startPoint_2 = Curve.StartPoint(curve=firstItem)
byOrigin_2 = CoordinateSystem.ByOrigin(origin=startPoint_2)

# group: Input
# note: Point de départ
select_model_element_4 = DSModelElementSelection()  # 1 picked in the model

curves_10 = Element.Curves(element=select_model_element_4)
centerPoint = Circle.CenterPoint(circle=curves_10)
byOrigin_3 = CoordinateSystem.ByOrigin(origin=centerPoint)
ZAxis = Vector.ZAxis()

# group: Input
# note: Angle de départ
number_slider_2 = DoubleSlider(90, range=20..160 step 5)

rotate = CoordinateSystem.Rotate(coordinateSystem=byOrigin_3, origin=centerPoint, axis=ZAxis, degrees=number_slider_2)

# group: To Revit
# note: Amorce placée
transform = Geometry.Transform(geometry=firstItem, fromCoordinateSystem=byOrigin_2, contextCoordinateSystem=rotate, lacing=Longest)

endPoint = Curve.EndPoint(curve=transform)
ZAxis_2 = Vector.ZAxis()
code_block_5 = CodeBlock { 1; }
tangentAtParameter_2 = Curve.TangentAtParameter(curve=transform, param=code_block_5)
code_block_6 = CodeBlock { 90; }
rotate_2 = Vector.Rotate(vector=ZAxis_2, axis=tangentAtParameter_2, degrees=code_block_6)
byOriginVectors = CoordinateSystem.ByOriginVectors(origin=endPoint, xAxis=rotate_2, yAxis=tangentAtParameter_2)
endPoint_2 = Curve.EndPoint(curve=restOfItems)
byTwoPoints = Vector.ByTwoPoints(start=startPoint, end=endPoint_2)
getItemAtIndex_5 = List.GetItemAtIndex(list=byTwoPoints, index=round)
ZAxis_3 = Vector.ZAxis()
YAxis = Vector.YAxis()
ZAxis_4 = Vector.ZAxis()
angleAboutAxis = Vector.AngleAboutAxis(vector=tangentAtParameter, otherVector=YAxis, rotationAxis=ZAxis_4)
getItemAtIndex_6 = List.GetItemAtIndex(list=angleAboutAxis, index=round)

# group: Background
code_block_7 = CodeBlock { 360; }
sub = getItemAtIndex_6 - code_block_7
code_block_8 = CodeBlock { 180; }
gt = _ > code_block_8  # unwired: x
replaceByCondition = Replace(item=getItemAtIndex_6, replaceWith=sub, condition=gt)
code_block_9 = CodeBlock { 1; }
round_2 = Math.Round(number=replaceByCondition, digits=code_block_9)

# group: Background
# note: Crée listes cumulées
python_script_2 = Python(IN[0]=round_2)  # CPython3; same code as python_script

code_block_10 = CodeBlock { 0; }
sub_2 = python_script_2 - code_block_10
sum = Math.Sum(values=sub_2)
rotate_3 = Vector.Rotate(vector=getItemAtIndex_5, axis=ZAxis_3, degrees=sum)

# group: Background
# note: Crée listes cumulées
python_script_3 = Python(IN[0]=rotate_3)  # CPython3; same code as python_script

X = Vector.X(vector=python_script_3)
sum_2 = Math.Sum(values=X)
Y = Vector.Y(vector=python_script_3)
sum_3 = Math.Sum(values=Y)
byCoordinates = Point.ByCoordinates(x=sum_2, y=sum_3)
byCoordinates_2 = Vector.ByCoordinates(x=sum_2, y=sum_3)
ZAxis_5 = Vector.ZAxis()
code_block_11 = CodeBlock { 90; }
rotate_4 = Vector.Rotate(vector=byCoordinates_2, axis=ZAxis_5, degrees=code_block_11)
byOriginVectors_2 = CoordinateSystem.ByOriginVectors(origin=byCoordinates, xAxis=byCoordinates_2, yAxis=rotate_4)
byOrigin_4 = CoordinateSystem.ByOrigin()
transform_2 = CoordinateSystem.Transform(coordinateSystem=byOriginVectors_2, fromCoordinateSystem=byOrigin_4, contextCoordinateSystem=byOriginVectors, lacing=Longest)
origin = CoordinateSystem.Origin(coordinateSystem=transform_2)
ZAxis_6 = Vector.ZAxis()
code_block_12 = CodeBlock { -90; }
rotate_5 = CoordinateSystem.Rotate(coordinateSystem=transform_2, origin=origin, axis=ZAxis_6, degrees=code_block_12)
addItemToFront = List.AddItemToFront(item=byOriginVectors, list=rotate_5)
transform_3 = Geometry.Transform(geometry=getItemAtIndex_3, fromCoordinateSystem=getItemAtIndex_4, contextCoordinateSystem=addItemToFront)
tangentAtParameter_3 = Curve.TangentAtParameter(curve=firstItem, param=code_block_4)
angleAboutAxis_2 = Vector.AngleAboutAxis(vector=tangentAtParameter_3, otherVector=YAxis, rotationAxis=ZAxis_4)
XAxis = CoordinateSystem.XAxis(coordinateSystem=byOriginVectors_2)
angleAboutAxis_3 = Vector.AngleAboutAxis(vector=XAxis, otherVector=YAxis, rotationAxis=ZAxis_4)
