# Dynamo graph Path_Base_Guided_Random.dyn (Dynamo 2.18.1.5096)
# author: Sven
# Path finding Guided random
# packages: GenerativeDesign 6.0.2.0

# group: Pièces
# note: Pièces

# group: Pièces
# note: Pièces

# group: Contraintes
# note: Contrainte

# group: Contraintes
# note: Contrainte

# group: Nombre de pièces à générer
# note: NB
# note: Pièces

# group: Input
# note: Amorce
select_model_element = DSModelElementSelection()  # 1 picked in the model

curves = Element.Curves(element=select_model_element)
remember = Data.Remember(curves)

# group: Background
# note: Element d'amorce
firstItem = List.FirstItem(list=remember)
code_block = CodeBlock { 1; }
tangentAtParameter = Curve.TangentAtParameter(curve=firstItem, param=code_block)
startPoint = Curve.StartPoint(curve=firstItem)
byOrigin = CoordinateSystem.ByOrigin(origin=startPoint)

# group: Input
# note: Angle Droite 45°
select_model_elements = DSModelElementsSelection()  # 2 picked in the model

curves_2 = Element.Curves(element=select_model_elements)
remember_2 = Data.Remember(curves_2)
flatten = List.Flatten(list=remember_2)
byJoinedCurves = PolyCurve.ByJoinedCurves(curves=flatten)

# group: Input
# note: Angle Droite 15°
select_model_elements_2 = DSModelElementsSelection()  # 2 picked in the model

curves_3 = Element.Curves(element=select_model_elements_2)
remember_3 = Data.Remember(curves_3)
flatten_2 = List.Flatten(list=remember_3)
byJoinedCurves_2 = PolyCurve.ByJoinedCurves(curves=flatten_2)

# group: Input
# note: Segment droit
select_model_element_2 = DSModelElementSelection()  # 1 picked in the model

curves_4 = Element.Curves(element=select_model_element_2)
remember_4 = Data.Remember(curves_4)

# group: Input
# note: Angle Gauche 15°
select_model_elements_3 = DSModelElementsSelection()  # 2 picked in the model

curves_5 = Element.Curves(element=select_model_elements_3)
remember_5 = Data.Remember(curves_5)
flatten_3 = List.Flatten(list=remember_5)
byJoinedCurves_3 = PolyCurve.ByJoinedCurves(curves=flatten_3)

# group: Input
# note: Angle Gauche 45°
select_model_elements_4 = DSModelElementsSelection()  # 2 picked in the model

curves_6 = Element.Curves(element=select_model_elements_4)
remember_6 = Data.Remember(curves_6)
flatten_4 = List.Flatten(list=remember_6)
byJoinedCurves_4 = PolyCurve.ByJoinedCurves(curves=flatten_4)

# group: Background - Liste des pièces de jeu de base
list_create = List.Create(item0=byJoinedCurves, item1=byJoinedCurves_2, item2=remember_4, item3=byJoinedCurves_3, item4=byJoinedCurves_4)
# note: Liste de toutes les pièces
flatten_5 = List.Flatten(list=list_create)

# group: Input - Nombre de pièces à générer
# note: Nombre de pièces à poser
nombre_de_pièces = DoubleSlider(9, range=7..9 step 1)  # graph input

# group: Input
# note: Angle de départ
angle_amorce = DoubleSlider(90, range=45..135 step 5)  # graph input

# group: Background - Choix des pièces de façon aléatoire guidée
python_script = Python(IN[0]=nombre_de_pièces, IN[1]=angle_amorce)  # CPython3
# ---------- python_script.python (45 lines) ----------
# Load the Python Standard and DesignScript Libraries
import sys
import clr
clr.AddReference('ProtoGeometry')
from Autodesk.DesignScript.Geometry import *
import random

# Place your code below this line

# Longueur souhaitée de la séquence
length_of_sequence = int(IN[0])

#Valeur de base de l'angle d'amorce pour la valeur cumulée
amorce_angle = 90-int(IN[1])

# Définir les valeurs possibles pour les objets
values = [-45, -15, 0, 15, 45]

# Listes pour stocker la séquence générée et les indices correspondants
sequence = []
indices = []

# Valeur cumulée actuelle
cumulative_value = 0

# Générer la séquence
for i in range(length_of_sequence):
    # Choisissez une valeur au hasard parmi celles qui ne feront pas dépasser la somme cumulée de 60 ou -60
    valid_choices = [idx for idx, v in enumerate(values) if -45 <= cumulative_value + v <= 45]
    if not valid_choices:
        # Si aucune valeur n'est valide, arrêtez la boucle
        break

    chosen_index = random.choice(valid_choices)
    chosen_value = values[chosen_index]
    sequence.append(chosen_value)
    indices.append(chosen_index)
    cumulative_value += chosen_value

print("Séquence générée:", sequence)
print("Indices correspondants:", indices)
print("Valeur cumulée:", cumulative_value)

# Assign your output to the OUT variable.
OUT = sequence, indices, cumulative_value
# ----------------------------------------
code_block_2 = CodeBlock { 1; }
getItemAtIndex = List.GetItemAtIndex(list=python_script, index=code_block_2)

# group: Background
# note: Liste des pièces générées
getItemAtIndex_2 = List.GetItemAtIndex(list=flatten_5, index=getItemAtIndex)

# group: Background
code_block_3 = CodeBlock { 1; }
tangentAtParameter_2 = Curve.TangentAtParameter(curve=flatten_5, param=code_block_3)
getItemAtIndex_3 = List.GetItemAtIndex(list=tangentAtParameter_2, index=getItemAtIndex)

# group: Background - Calcul des orientations
XAxis = Vector.XAxis()
angleWithVector = Vector.AngleWithVector(vector=getItemAtIndex_3, otherVector=XAxis)
code_block_4 = CodeBlock { 1; }
round = Math.Round(number=angleWithVector, digits=code_block_4)
code_block_5 = CodeBlock { 0; }
sub = round - code_block_5
# note: Crée listes cumulées
python_script_2 = Python(IN[0]=sub)  # CPython3
# ---------- python_script_2.python (13 lines) ----------
# Load the Python Standard and DesignScript Libraries
import sys
import clr
clr.AddReference('ProtoGeometry')
from Autodesk.DesignScript.Geometry import *

# The inputs to this node will be stored as a list in the IN variables.
l = IN[0]

# Place your code below this line
ls = [l[:i+1] for i in range(len(l))]
# Assign your output to the OUT variable.
OUT = ls
# ----------------------------------------
code_block_6 = CodeBlock { 90; }
sub_2 = python_script_2 - code_block_6
# note: Orientation point de contact
sum = Math.Sum(values=sub_2)

# group: Background - Crée les pièces orientées en place
startPoint_2 = Curve.StartPoint(curve=flatten_5)
getItemAtIndex_4 = List.GetItemAtIndex(list=startPoint_2, index=getItemAtIndex)
ZAxis = Vector.ZAxis()
code_block_7 = CodeBlock { 0; }
addItemToFront = List.AddItemToFront(item=code_block_7, list=sum)
rotate = Geometry.Rotate(geometry=getItemAtIndex_2, origin=getItemAtIndex_4, axis=ZAxis, degrees=addItemToFront)

# group: Input
# note: Point de départ
select_model_element_3 = DSModelElementSelection()  # 1 picked in the model

curves_7 = Element.Curves(element=select_model_element_3)
remember_7 = Data.Remember(curves_7)

# group: Background
centerPoint = Circle.CenterPoint(circle=remember_7)
byOrigin_2 = CoordinateSystem.ByOrigin(origin=centerPoint)
ZAxis_2 = Vector.ZAxis()
rotate_2 = CoordinateSystem.Rotate(coordinateSystem=byOrigin_2, origin=centerPoint, axis=ZAxis_2, degrees=angle_amorce)

# group: Amorce
# note: Amorce placée
transform = Geometry.Transform(geometry=firstItem, fromCoordinateSystem=byOrigin, contextCoordinateSystem=rotate_2, lacing=Longest)

# group: Background - Alignement et point de contact Amorce
endPoint = Curve.EndPoint(curve=transform)
ZAxis_3 = Vector.ZAxis()
code_block_8 = CodeBlock { 1; }
tangentAtParameter_3 = Curve.TangentAtParameter(curve=transform, param=code_block_8)
code_block_9 = CodeBlock { 90; }
rotate_3 = Vector.Rotate(vector=ZAxis_3, axis=tangentAtParameter_3, degrees=code_block_9)
byOriginVectors = CoordinateSystem.ByOriginVectors(origin=endPoint, xAxis=rotate_3, yAxis=tangentAtParameter_3)

# group: Background - Crée les points orientés pour les pièces
byCoordinates = Point.ByCoordinates()
startPoint_3 = Curve.StartPoint(curve=rotate)
endPoint_2 = Curve.EndPoint(curve=rotate)
byTwoPoints = Vector.ByTwoPoints(start=startPoint_3, end=endPoint_2)
byOrigin_3 = CoordinateSystem.ByOrigin()

# group: Background - Crée les points orientés pour les pièces > Background
# note: Crée listes cumulées
python_script_3 = Python(IN[0]=byTwoPoints)  # CPython3; same code as python_script_2

# group (continued): Background - Crée les points orientés pour les pièces
X = Vector.X(vector=python_script_3)
sum_2 = Math.Sum(values=X)
Y = Vector.Y(vector=python_script_3)
sum_3 = Math.Sum(values=Y)
byCoordinates_2 = Point.ByCoordinates(x=sum_2, y=sum_3)
# note: Crée les points de débuts et de fin des pièces orientées au nord depuis point d'origine
addItemToFront_2 = List.AddItemToFront(item=byCoordinates, list=byCoordinates_2)
# note: Replace les points selon l'amorce
transform_2 = Geometry.Transform(geometry=addItemToFront_2, fromCoordinateSystem=byOrigin_3, contextCoordinateSystem=byOriginVectors, lacing=Longest)

# group: Background - Création des pièces assemblées à l'origine
byOrigin_4 = CoordinateSystem.ByOrigin(origin=getItemAtIndex_4)
# note: Replace les pièces selon origine
transform_3 = Geometry.Transform(geometry=rotate, fromCoordinateSystem=byOrigin_4, contextCoordinateSystem=byOrigin_3, lacing=Longest)
byCoordinates_3 = Vector.ByCoordinates()
byCoordinates_4 = Vector.ByCoordinates(x=sum_2, y=sum_3)
addItemToFront_3 = List.AddItemToFront(item=byCoordinates_3, list=byCoordinates_4)
# note: Pièces assemblées
translate = Geometry.Translate(geometry=transform_3, direction=addItemToFront_3)

# group: Création du chemin de pièces orientées
# note: Replace les pièces selon l'amorce
transform_4 = Geometry.Transform(geometry=translate, fromCoordinateSystem=byOrigin_3, contextCoordinateSystem=byOriginVectors, lacing=Longest)

byJoinedCurves_5 = PolyCurve.ByJoinedCurves(curves=transform_4)

# group: Input
# note: Cible de sortie
select_model_element_4 = DSModelElementSelection()  # 1 picked in the model

curves_8 = Element.Curves(element=select_model_element_4)
remember_8 = Data.Remember(curves_8)
flatten_6 = List.Flatten(list=remember_8)

# group: Background - Calcul points des pièces
# note: Points des pièces
python_script_4 = Python(IN[0]=getItemAtIndex)  # CPython3
# ---------- python_script_4.python (25 lines) ----------
# Load the Python Standard and DesignScript Libraries
import sys
import clr
clr.AddReference('ProtoGeometry')
from Autodesk.DesignScript.Geometry import *

# The inputs to this node will be stored as a list in the IN variables.
ls_pieces = IN[0]

ls_points = []

for i in ls_pieces:
    if i == 0 or i == 4:
        ls_points.append(2)
    elif i == 1 or i == 3:
        ls_points.append(4)
    elif i == 2:
        ls_points.append(8)
    else:
        ls_points.append(0)

# Place your code below this line

# Assign your output to the OUT variable.
OUT = ls_points
# ----------------------------------------
# note: Points totaux du cheminement
sum_4 = Math.Sum(values=python_script_4)

# group: Input
# note: Obstacle
select_model_elements_5 = DSModelElementsSelection()  # 4 picked in the model

curves_9 = Element.Curves(element=select_model_elements_5)
remember_9 = Data.Remember(curves_9)
flatten_7 = List.Flatten(list=remember_9)
byJoinedCurves_6 = PolyCurve.ByJoinedCurves(curves=flatten_7)

# group: Input
# note: Cadre de jeu
select_model_elements_6 = DSModelElementsSelection()  # 5 picked in the model

curves_10 = Element.Curves(element=select_model_elements_6)
remember_10 = Data.Remember(curves_10)
flatten_8 = List.Flatten(list=remember_10)
byJoinedCurves_7 = PolyCurve.ByJoinedCurves(curves=flatten_8)

# group: Contraintes
# note: Cible de sortie
code_block_10 = CodeBlock(b=flatten_6) { a=b; }
# note: Obstacle
code_block_11 = CodeBlock(b=byJoinedCurves_6) { a=b; }
# note: Cadre du jeu
code_block_12 = CodeBlock(b=byJoinedCurves_7) { a=b; }

# group: Background
flatten_9 = List.Flatten(list=code_block_10)
intersect = Geometry.Intersect(geometry=byJoinedCurves_5, other=flatten_9)
parameterAtPoint = Curve.ParameterAtPoint(curve=byJoinedCurves_5, point=intersect)
# note: Touche la cible
doesIntersect = Geometry.DoesIntersect(geometry=byJoinedCurves_5, other=flatten_9)

# group: Export cheminement vers Revit
views = Views("Level 0")
trimByEndParameter = Curve.TrimByEndParameter(curve=byJoinedCurves_5, endParameter=parameterAtPoint)
curves_11 = PolyCurve.Curves(polyCurve=trimByEndParameter)
byCurve = DetailCurve.ByCurve(view=views, curve=curves_11)

# note: Touche l'obstacle
touche_l_obstacle = Geometry.DoesIntersect(geometry=byJoinedCurves_5, other=code_block_11)
# note: Touche le cadre
doesIntersect_2 = Geometry.DoesIntersect(geometry=byJoinedCurves_5, other=code_block_12)

# group: Background - Calcul de la note du cheminement
# note: Défini un multiplicateur à 1 si la solution touche la cible et ne touche ni l'obstacle ni le cadre, sinon le passe à 0
python_script_5 = Python(IN[0]=doesIntersect, IN[1]=touche_l_obstacle, IN[2]=doesIntersect_2)  # CPython3
# ---------- python_script_5.python (22 lines) ----------
# Load the Python Standard and DesignScript Libraries
import sys
import clr
clr.AddReference('ProtoGeometry')
from Autodesk.DesignScript.Geometry import *

# The inputs to this node will be stored as a list in the IN variables.
touche_cible = IN[0][0]
touche_obstacle = IN[1]
touche_cadre = IN[2]

multiplicateur = 2

# Place your code below this line
if touche_cible == True and touche_obstacle == False and touche_cadre == False:
    multiplicateur = 1
else:
    multiplicateur = 0


# Assign your output to the OUT variable.
OUT = multiplicateur
# ----------------------------------------
mul = sum_4 * python_script_5

# group: Output - Metrics
# note: Nombre de points du cheminement
nombre_de_points_du_cheminement = Watch(mul)  # graph output

# group: Background
length = Curve.Length(curve=byJoinedCurves_5)
# note: Note pièces totales / longueure totale
div = sum_4 / length
code_block_13 = CodeBlock { 2; }
round_2 = Math.Round(number=div, digits=code_block_13)

# group: Output - Metrics
# note: Note pièces/longueur cheminement
note_pieces_longueur = Watch(round_2)  # graph output

# group: Background
# note: Longueur du cheminement jusqu'à la cible
segmentLengthAtParameter = Curve.SegmentLengthAtParameter(curve=byJoinedCurves_5, parameter=parameterAtPoint)
flatten_10 = List.Flatten(list=segmentLengthAtParameter)
code_block_14 = CodeBlock { 2; }
round_3 = Math.Round(number=flatten_10, digits=code_block_14)

count = List.Count(list=round_3)
python_script_6 = Python(IN[0]=round_3, IN[1]=count)  # CPython3
# ---------- python_script_6.python (19 lines) ----------
# Load the Python Standard and DesignScript Libraries
import sys
import clr
clr.AddReference('ProtoGeometry')
from Autodesk.DesignScript.Geometry import *

# The inputs to this node will be stored as a list in the IN variables.
long_val = IN[0]
has_val = IN[1]

out_val = 2

# Place your code below this line
if has_val > 0:
    out_val = long_val[0]
else:
    out_val = 0
# Assign your output to the OUT variable.
OUT = out_val
# ----------------------------------------

# group: Output - Metrics
# note: Longueur jusqu'à cible
longueur_solution = Watch(python_script_6)  # graph output

python_script_7 = Python(IN[0]=doesIntersect_2)  # CPython3
# ---------- python_script_7.python (16 lines) ----------
# Load the Python Standard and DesignScript Libraries
import sys
import clr
clr.AddReference('ProtoGeometry')
from Autodesk.DesignScript.Geometry import *

# The inputs to this node will be stored as a list in the IN variables.
test_val = IN[0]
val = 2
# Place your code below this line
if test_val == True:
    val = int(1)
else:
    val = int(0)
# Assign your output to the OUT variable.
OUT = val
# ----------------------------------------

# group: Output - Metrics
# note: Touche le cadre
touche_cadre = Watch(python_script_7)  # graph output

python_script_8 = Python(IN[0]=touche_l_obstacle)  # CPython3
# ---------- python_script_8.python (16 lines) ----------
# Load the Python Standard and DesignScript Libraries
import sys
import clr
clr.AddReference('ProtoGeometry')
from Autodesk.DesignScript.Geometry import *

# The inputs to this node will be stored as a list in the IN variables.
test_val = IN[0]
val = 2
# Place your code below this line
if test_val == True:
    val = 1
else:
    val = 0
# Assign your output to the OUT variable.
OUT = int(val)
# ----------------------------------------

# group: Output - Metrics
# note: Touche l'obstacle
touche_obstacle = Watch(python_script_8)  # graph output

python_script_9 = Python(IN[0]=doesIntersect)  # CPython3
# ---------- python_script_9.python (16 lines) ----------
# Load the Python Standard and DesignScript Libraries
import sys
import clr
clr.AddReference('ProtoGeometry')
from Autodesk.DesignScript.Geometry import *

# The inputs to this node will be stored as a list in the IN variables.
test_val = IN[0][0]
val = 2
# Place your code below this line
if test_val == True:
    val = 1
else:
    val = 0
# Assign your output to the OUT variable.
OUT = int(val)
# ----------------------------------------

# group: Output - Metrics
# note: Touche la cible
touche_cible = Watch(python_script_9)  # graph output

# group: Background - Liste des pièces "simplifiées" de jeu de base
list_create_2 = List.Create(item0=byJoinedCurves, item1=remember_4, item2=byJoinedCurves_4)
# note: Liste de toutes les pièces
flatten_11 = List.Flatten(list=list_create_2)
